# Grasshopper definition cat dom.gh (Grasshopper 1.0.7)
# plug-ins: GhPolyhedra, LunchBox

icosphere = IcoSphere(Plane=PlaneXY(0, 0, 0), Scale=Slider(36, range=0..300), Density=Slider(2, range=0..5))
faceb = FaceBoundaries(Mesh=icosphere)
medges = MeshEdges()  # -> NakedEdges, InteriorEdges, NonManifoldEdges
mesh = MeshBrep(Settings={GridMaxCount=0, GridMinCount=16, JaggedSeams=False, MaxEdgeLength=0, MinEdgeLength=0.0001, MinTolerance=0, Refine=True, RefineAngle=0, RelativeTolerance=0.65, SimplePlanes=True, Tolerance=0})
boundary = BoundarySurfaces(Edges=faceb)
join = BrepJoin(Breps=boundary)  # -> Breps, Closed
box = Box(join.Breps)
debrep = DeconstructBrep(Brep=box)  # -> Faces, Edges, Vertices
item = ListItem(List=reverse(debrep.Faces), Index=0, Wrap=True)
item_2 = ListItem(List=reverse(debrep.Edges), Index=0, Wrap=True)
number_slider = Slider(1.6, range=0.1..2)
len = Length(Curve=item_2)
division = Division(A=len, B=number_slider)
Z = UnitZ(Factor=division)
multiplication = Multiplication(A=number_slider, B=Slider(5, range=0..5))
neg = Negative(Value=Z)
move = Move(Geometry=item, Motion=neg)  # -> Geometry, Transform
Z_2 = UnitZ(Factor=multiplication)
split = SplitBrep(Brep=join.Breps, Cutter=move.Geometry)
item_3 = ListItem(List=split, Index=0, Wrap=True)
debrep_2 = DeconstructBrep(Brep=item_3)  # -> Faces, Edges, Vertices
move_2 = Move(Geometry=debrep_2.Faces, Motion=Z_2)  # -> Geometry, Transform
frame = PanelFrame(Panel=move_2.Geometry, ScaleFactor=Slider(0.8, range=0.1..0.9))  # -> PanelFrame, Panel
brep = Brep(frame.PanelFrame)
brep_2 = Brep(frame.Panel)
join_2 = BrepJoin(Breps=brep_2)  # -> Breps, Closed
